# Grasshopper definition equad.ghx (Grasshopper 1.0.7)
# plug-ins: Human, Weaverbird, Kangaroo2 Components

python = GhPythonScript()  # -> out, ghmesh; disabled
# ---------- python: Python ----------
__author__ = "arpj"


from compas_ghpython.artists import MeshArtist

artist = MeshArtist(mesh)


ghmesh = artist.draw_mesh()
# ---------- end python ----------

pipeline = GeometryPipeline(
    GroupByLayer=False,
    GroupByType=False,
    IncludeHidden=True,
    IncludeLocked=True,
    LayerFilter="supports",
    NameFilter="*",
    SublayerFiltering=True,
    TypeFilter=1)
# INPUT
pipeline_2 = GeometryPipeline(
    GroupByLayer=False,
    GroupByType=False,
    IncludeHidden=True,
    IncludeLocked=True,
    LayerFilter="supports2",
    NameFilter="*",
    SublayerFiltering=True,
    TypeFilter=1)
pt = Point(pipeline_2)
pt_2 = Point(pipeline)
pt_3 = Point([pt_2, pt])

python_2 = GhPythonScript()  # -> out, mesh; disabled
# ---------- python_2: Python ----------
__author__ = "Rafael Pastrana"

import compas
from compas.datastructures import Mesh


mesh = Mesh.from_obj(compas.get('faces.obj'))
# ---------- end python_2 ----------

number_slider = Slider(9, range=0..100)
number_slider_2 = Slider(18, range=0..100)
crv = Curve(<curve referenced from the Rhino model>)
num = Number(number_slider)
num_2 = Number(number_slider)
crv_2 = Curve(crv)
num_3 = Number(num)
num_4 = Number(num_2)
boundary = BoundarySurfaces(Edges=crv_2)
sdivide = DivideSurface(Surface=boundary, UCount=num_3, VCount=num_4)  # -> simplify(Points), Normals, Parameters

number_slider_3 = Slider(14, range=0..100)  # disabled
merge = Merge(Data1=number_slider_3, Data2=Slider(10, range=0..100), Data3=Slider(33, range=0..100))
num_5 = Number(Slider(0, range=-10..20))

python_3 = GhPythonScript(mesh=python_2.mesh)  # -> out, mesh; disabled
# ---------- python_3: Python ----------
__author__ = "arpj"


from compas.datastructures import mesh_subdivide

mesh = mesh_subdivide(mesh, k=1)
# ---------- end python_3 ----------

# ----
# CREATE GRID
pt_4 = Point(sdivide.Points)
flip = FlipMatrix(Data=pt_4)
pline = PolyLine(Vertices=pt_4, Closed=False)
pline_2 = PolyLine(Vertices=flip, Closed=False)
entwine = Entwine(Branch00=pline_2, Branch01=pline, FlattenInputs=True)
explode = Explode(Curve=entwine, Recursive=True)  # -> Segments, Vertices
flatten = FlattenTree(Tree=explode.Segments, Path="{0}")
crv_3 = Curve(flatten)

pt_5 = Point(sdivide.Points)
crv_4 = Curve(entwine)
item = ListItem(List=crv_4, Index=0, Wrap=True)  # -> Item1, Item
merge_2 = Merge(Data1=item.Item1, Data2=item.Item)
explode_2 = Explode(Curve=merge_2, Recursive=True)  # -> Segments, Vertices
crv_5 = Curve(explode_2.Segments)
relitem = RelativeItem(Tree=pt_5, Offset="{-1}[1]", WrapPaths=False, WrapItems=False)  # -> ItemA, ItemB
relitem_2 = RelativeItem(Tree=pt_5, Offset="{1}[1]", WrapPaths=False, WrapItems=False)  # -> ItemA, ItemB
ln = Line(StartPoint=relitem.ItemA, EndPoint=relitem.ItemB)
ln_2 = Line(StartPoint=relitem_2.ItemA, EndPoint=relitem_2.ItemB)
flip_2 = FlipCurve(Curve=ln_2)  # -> Curve, Flag
crv_6 = Curve(crv_5)
entwine_2 = Entwine(Branch00=ln, Branch01=flip_2.Curve, FlattenInputs=True)
shatter = Shatter(Curve=reparameterize(entwine_2), Parameters="0.5")
entwine_3 = Entwine(Branch00=shatter, Branch01=crv_6, FlattenInputs=True)
explode_3 = Explode(Curve=entwine_3, Recursive=True)  # -> Segments, Vertices
end = EndPoints(Curve=explode_3.Segments)  # -> Start, End
ln_3 = Line(StartPoint=end.Start, EndPoint=end.End)
flatten_2 = FlattenTree(Tree=ln_3, Path="{0}")
crv_7 = Curve(flatten_2)

item_2 = ListItem(List=crv_3, Index=Slider(61, range=1..100), Wrap=True)

# ----
# ROTATE GRID
crv_8 = Curve(crv_3)
wbweave = WeaverbirdsMeshFromLinesWeaveBack(Lines=crv_8, MaximumValence=4)
clean = CombineClean(Meshes=wbweave)
wbmidedge = WeaverbirdsMidedgeSubdivision(MeshCurves=clean, Level=1, SmoothNakedEdges=0)
explode_4 = Explode(Curve=wbmidedge, Recursive=True)  # -> flatten(Segments), Vertices
dupln = RemoveDuplicateLines(Lines=explode_4.Segments, Tolerance=0.01)
crv_9 = Curve(dupln)

crv_10 = Curve(crv_7)
wbweave_2 = WeaverbirdsMeshFromLinesWeaveBack(Lines=crv_10, MaximumValence=4)
crv_11 = Curve(crv_10)
python_4 = GhPythonScript(lines=crv_11)  # -> out, mesh, ghmesh; inputs lines: list
# ---------- python_4: Python ----------
from compas_rhino.utilities import get_line_coordinates
from compas.datastructures import Mesh
from compas_ghpython.artists import MeshArtist


mesh = Mesh.from_lines(get_line_coordinates(lines), delete_boundary_face=True)
a = MeshArtist(mesh)
ghmesh = a.draw_faces()
# ---------- end python_4 ----------
data = Data(python_4.mesh)
mesh = Mesh(python_4.ghmesh)

crv_12 = Curve(crv_9)
python_5 = GhPythonScript(lines=crv_12)  # -> out, mesh, ghmesh; inputs lines: list; same code as python_4
wbweave_3 = WeaverbirdsMeshFromLinesWeaveBack(Lines=crv_12, MaximumValence=4)
wbjoin = WeaverbirdsJoinMeshesAndWeld(Mesh=python_5.ghmesh, Weld=False)
mesh_2 = Mesh(wbjoin)
mesh_3 = Mesh(wbweave_3)
data_2 = Data(python_5.mesh)

mesh_4 = Mesh(mesh_3)
pt_6 = Point(pt_3)
num_6 = Number(num_5)
wbvertices = WeaverbirdsVerticesComponent(MeshClosedPolylinesGroup=mesh_4, Weld=True)
cp = ClosestPoint(Point=pt_6, Cloud=wbvertices)  # -> ClosestPoint, CPIndex, Distance

data_3 = Data(data_2)
mesh_5 = Mesh(mesh_3)
python_6 = GhPythonScript(mesh=data_3, ghpoints=cp.ClosestPoint)  # -> out, points; inputs ghpoints: list
# ---------- python_6: Python ----------
__author__ = "arpj"


from compas_rhino.utilities import get_point_coordinates
from compas.utilities import geometric_key

ghpoints = get_point_coordinates(ghpoints)

gkey_key = mesh.gkey_key()


points = []
for ghpoint in ghpoints:
    pt = gkey_key[geometric_key(ghpoint)]
    points.append(ghpoint)
# ---------- end python_6 ----------
python_7 = GhPythonScript()  # -> out, dva, dea
# ---------- python_7: Python ----------
__author__ = "Rafael Pastrana"


import scriptcontext as sc


dva = {
    'is_fixed': False,
    'x': 0.0,
    'y': 0.0,
    'z': 0.0,
    'px': 0.0,  # x component of point load at vertices
    'py': 0.0,  # y component of point load at vertices
    'pz': 10.0,  # z component of point load at vertices
    'rx': 0.0,
    'ry': 0.0,
    'rz': 0.0,
}

dea = {
    'qpre': 10.0,  # prescribed force densities
    'fpre': 0.0,  # prescribed edge forces
    'lpre': 0.0,  # prescribed edge lengths
    'linit': 0.0,  # initial edge length
    'E': 10.0,  # initial edge length (kN/mm2 => GPa)
    'radius': 2.5, # global initial cable radius (mm)
}

sc.sticky['dva'] = dva
sc.sticky['dea'] = dea
# ---------- end python_7 ----------
python_8 = GhPythonScript(mesh=data_3)  # -> out, points; disabled
# ---------- python_8: Python ----------
__author__ = "arpj"


points = []
for key in mesh.vertices():
    if mesh.vertex_degree(key) == 2:
        xyz = mesh.vertex_coordinates(key)
        points.append(xyz)
# ---------- end python_8 ----------
python_9 = GhPythonScript(mesh=data_3)  # -> out, points
# ---------- python_9: Python ----------
__author__ = "arpj"


points = []
for key in mesh.vertices_on_boundary():
    print(key)
    xyz = mesh.vertex_coordinates(key)
    points.append(xyz)
# ---------- end python_9 ----------
data_4 = Data(python_7.dva)
data_5 = Data(python_7.dea)
panel = Panel(data_4)
merge_3 = Merge(Data1=python_8.points, Data2=python_9.points, Data3=python_6.points)  # -> flatten(Result)
panel_2 = Panel(python_9.out)
python_10 = GhPythonScript(ghmesh=mesh_5, points=merge_3, projected=python_6.points, my_z=num_6)  # -> out, mesh; inputs points: list, projected: list
# ---------- python_10: Python ----------
__author__ = "Rafael Pastrana"


import scriptcontext as sc

from copy import deepcopy
from compas.datastructures import Mesh

from compas.utilities import geometric_key

from compas_rhino.helpers import mesh_from_guid
from compas_ghpython.artists import MeshArtist

# ==============================================================================
# Call Proxy Locally
# ==============================================================================


numerical = sc.sticky['numerical']
dr_numpy = numerical.dr_numpy

dea = sc.sticky['dea']
dva = sc.sticky['dva']

# mesh builder
mesh = mesh_from_guid(Mesh, ghmesh)

# update attributes
mesh.update_default_vertex_attributes(dva)
mesh.update_default_edge_attributes(dea)

# fix vertices
gkey_key = mesh.gkey_key()
projected = [geometric_key(pt) for pt in projected]

for point in points:
    gkey = geometric_key(point)
    vkey = gkey_key[gkey]
    mesh.set_vertex_attribute(vkey, 'is_fixed', True)
    
    if gkey in projected:
       mesh.set_vertex_attribute(vkey, 'z', my_z)
    
    """
    #Messing around with raising points
    x_0 = points[9][1]
    h = 10
    if vkey < 19:
         print(vkey)
         print(point)
         x_dist = point[1]
         mesh.set_vertex_attribute(vkey, 'z', 15+ h - (h/28**2)*(x_dist-x_0)**2)
     """

# query attributes
k_i = mesh.key_index()
vertices = mesh.get_vertices_attributes(('x', 'y', 'z'))
edges = [(k_i[u], k_i[v]) for u, v in mesh.edges()]
fixed = [k_i[key] for key in mesh.vertices_where({'is_fixed': True})]
loads = mesh.get_vertices_attributes(('px', 'py', 'pz'))
qpre = mesh.get_edges_attribute('qpre')
fpre = mesh.get_edges_attribute('fpre')
lpre = mesh.get_edges_attribute('lpre')
linit = mesh.get_edges_attribute('linit')
E = mesh.get_edges_attribute('E')
radius = mesh.get_edges_attribute('radius')

# carry out dynamic relaxation with numpy

xyz, q, f, l, r = dr_numpy(vertices,
                           edges,
                           fixed,
                           loads,
                           qpre,
                           fpre,
                           lpre,
                           linit,
                           E,
                           radius,
                           kmax=100,
                           callback=None
                           )

# update vertex coordinates
for key, attr in mesh.vertices(True):
    index = k_i[key]
    attr['x'] = xyz[index][0]
    attr['y'] = xyz[index][1]
    attr['z'] = xyz[index][2]
        
# update edges' force and length attributes 
for index, (u, v, attr) in enumerate(mesh.edges(True)):
    attr['f'] = f[index]
    attr['l'] = l[index]
# ---------- end python_10 ----------
panel_3 = Panel(python_10.out)
data_6 = Data(python_10.mesh)

# ----
# POST-PROCESS
data_7 = Data(data_6)
python_11 = GhPythonScript(mesh=data_7)  # -> out, vertices, edges, faces
# ---------- python_11: Python ----------
__author__ = "Rafael Pastrana"

from compas_ghpython.artists import MeshArtist


# ==============================================================================
# Visualize
# ==============================================================================

artist = MeshArtist(mesh)

# vertices = artist.draw_vertices()
edges = artist.draw_edges()
faces = artist.draw_faces()
mesh = artist.draw_mesh()
# ---------- end python_11 ----------
pt_7 = Point(python_11.vertices)
mesh_6 = Mesh(python_11.faces)
crv_13 = Curve(python_11.edges)

data_8 = Data(data_6)
python_12 = GhPythonScript(mesh=data_8)  # -> out, q, forces, radius
# ---------- python_12: Python ----------
forces = [attr['f'][0] for u , v, attr in mesh.edges(True)]
# ---------- end python_12 ----------
num_7 = Number(python_12.q)  # disabled
num_8 = Number(python_12.forces)
num_9 = Number(python_12.radius)  # disabled

crv_14 = Curve(crv_13)
end_2 = EndPoints(Curve=crv_14)  # -> Start, End
duppt = RemoveDuplicatePts(Points=[end_2.Start, end_2.End], Tolerance=0.01)
pdecon = Deconstruct(Point=duppt)  # -> XComponent, YComponent, ZComponent
sort = SortList(Keys=pdecon.ZComponent)  # -> reverse(Keys), ValuesA
item_3 = ListItem(List=sort.Keys, Index=0, Wrap=True)
num_10 = Number(item_3)

num_11 = Number(num_8)
python_13 = GhPythonScript(data=num_11)  # -> out, colors, colors_bar; inputs data: list
# ---------- python_13: Python ----------
import rhinoscriptsyntax as rs
from compas.utilities import i_to_rgb


dmin = min(data)
dmax = max(data)

print(dmin, dmax)
colors = [rs.CreateColor(i_to_rgb(value / dmax)) for value in data]
colors_bar = [rs.CreateColor(i_to_rgb((num * 0.10 * dmax))) for num in range(int(dmin), int(dmax), 10)]
# ---------- end python_13 ----------
crv_15 = Curve(crv_13)
colour = Colour(python_13.colors)
previewlw = CustomPreviewLineweights(Geometry=crv_15, Shader=colour, Thickness="3", Absolute=False)

num_12 = Number(num_10)
num_13 = Number(num_8)
sort_2 = SortList(Keys=num_13)  # -> Keys, ValuesA
max_height_m = Panel(num_12)
graph = QuickGraph(sort_2.Keys, SortOrder=0)

Y = Slider(60, range=0..60)
scale = Slider(7, range=0..10)
neg = Negative(Value=Y)
X = UnitX(Factor=1)
rad = Radians(Degrees=Slider(0, range=0..100))
rad_2 = Radians(Degrees=Slider(88, range=0..100))
pt_8 = ConstructPoint(XCoordinate=Slider(-10, range=-10..10), YCoordinate=neg, ZCoordinate=Slider(30, range=0..30))
Y_2 = UnitY(Factor=1)
xz = XZPlane(Origin=pt_8)
line = LineSDL(Start=pt_8, Direction=X, Length=1)
rot3d = Rotate3D(Geometry=xz, Angle=rad_2, Center=pt_8, Axis=Vector(0, 0, 1))  # -> Geometry, Transform
rot3d_2 = Rotate3D(Geometry=rot3d.Geometry, Angle=rad, Center=pt_8, Axis=line)  # -> Geometry, Transform
rectangle = Rectangle(Plane=rot3d.Geometry, XSize=Domain(-1, 1), YSize=Domain(-2, 2), Radius=0)  # -> Rectangle, Length
area = Area(Geometry=rectangle.Rectangle)  # -> Area, Centroid
scale_2 = Scale(Geometry=rectangle.Rectangle, Center=area.Centroid, Factor=scale)  # -> Geometry, Transform
crv_16 = Curve(scale_2.Geometry)
num_14 = Number(num_8)
bnd = Bounds(Numbers=num_14)
dedomain = DeconstructDomain(Domain=bnd)  # -> Start, End
range = Range(Domain=bnd, Steps=10)
gradient = Gradient(
    LowerLimit=dedomain.End,
    UpperLimit=dedomain.Start,
    Parameter=range,
    stops=[0: RGB(255, 5, 5), 0.365: RGB(255, 255, 0), 0.66: RGB(0, 200, 255), 1: RGB(0, 34, 255)])  # disabled
eval = Evaluate(F="round(x, 4)", x=range)  # disabled
crv_17 = Curve(crv_16)  # disabled
panel_4 = Panel(" kN")  # disabled
concat = Concatenate(FragmentA=eval, FragmentB=panel_4)  # disabled
legend = Legend(Colour=gradient, Tags=concat, Rectangle=crv_17, LegendType=1)  # disabled
